# Grasshopper definition circle.gh (Grasshopper 1.0.7)

X = Slider(6.864, range=0..10)
Y = Slider(27.767, range=0..50)
Z = Slider(7.283, range=0..30)
python = GhPythonScript(radius=Slider(14, range=0..100), x=X, y=Y, z=Z)  # -> out, geom
# ---------- python: Python ----------
import rhinoscriptsyntax as rs
import Rhino.Geometry as rg


center = rg.Point3d(x,y,z)
geom = rg.Circle(center, radius)
# ---------- end python ----------
