# Grasshopper definition first_lesson.gh (Grasshopper 1.0.7)

python = GhPythonScript(x=Slider(2, range=0..10))  # -> out, a; inputs x: Int32
# ---------- python: Python ----------
import rhinoscriptsyntax as rs

a=x
# ---------- end python ----------
panel = Panel(python.a)
