# Grasshopper definition sine_wave.gh (Grasshopper 1.0.7)

length = Slider(73, range=0..100)
amplitude = Slider(7, range=0..10)
length_2 = Slider(80, range=0..100)
amplitude_2 = Slider(7, range=0..10)
freq = Slider(0.401, range=0..1)
freq_2 = Slider(0.379, range=0..1)
python = GhPythonScript(amplitude=amplitude, length=length, frequency=freq)  # -> out, a; inputs length: Int32
# ---------- python: Python ----------
import Rhino.Geometry as rg
import sys
import math

## File paths used by this interpreter
print(sys.path)

## Math module functions
print(dir(math))


## Sine Wave
points = []
points2 = []

for x in range(length):
    z = amplitude*math.sin(frequency*x)
    point1 = rg.Point3d(x,10,z)
    points.append(point1)
    points2.append(rg.Point3d(x,10,z))

#a= points
curve = rg.NurbsCurve.CreateInterpolatedCurve(points,3)
a=curve

#rg.NurbsCurve.CreateInterpolatedCurve(
# ---------- end python ----------
python_2 = GhPythonScript(amplitude=amplitude_2, length=length_2, frequency=freq_2)  # -> out, a; inputs length: Int32
# ---------- python_2: Python ----------
import Rhino.Geometry as rg
import sys
import math

## File paths used by this interpreter
print(sys.path)

## Math module functions
print(dir(math))


## Sine Wave
points = []
points2 = []

for x in range(length):
    z = amplitude*math.sin(frequency*x)
    point1 = rg.Point3d(x,0,z)
    points.append(point1)
    points2.append(rg.Point3d(x,10,z))

#a= points
curve = rg.NurbsCurve.CreateInterpolatedCurve(points,3)
a=curve

#rg.NurbsCurve.CreateInterpolatedCurve(
# ---------- end python_2 ----------
edgesrf = EdgeSurface(CurveA=python_2.a, CurveB=python.a)
