# Grasshopper definition data_from_excel.gh (Grasshopper 1.0.7)

python = GhPythonScript()  # -> out, a, b, c
# ---------- python: Python ----------
import clr
clr.AddReference("Microsoft.Office.Interop.Excel")
import Microsoft.Office.Interop.Excel as excel

## Instantiating an excel class object
ex = excel.ApplicationClass()

## Opening an workbook
workbook = ex.Workbooks.Open("C:\\Users\\KVBA\\OneDrive - Ramboll\\Documents\\Literature\\Tutorials\\Grasshopper and Python\\Reading excel file\\03_03.xlsx")

## Read worksheet
ws = workbook.Worksheets[1] ## Note that the index starts at 1

## Extracting the data
pX = []
pY = []
pZ = []

try:

    for i in range(ws.UsedRange.rows.Count):
    
        if i !=0:
            ## get the values 
            x = ws.Range("A{}".format(i+1)).Value2 
            y = ws.Range("B{}".format(i+1)).Value2
            z = ws.Range("C{}".format(i+1)).Value2
            ## add the values
            pX.append(x)
            pY.append(y)
            pZ.append(z)
except:
    print("Error:", e)

finally:
    ## Once the data is extracted, close the excel
    workbook.Close(False) ## here save file = False
    ex.Quit()
    
    ## Assign the outputs
    a = pX
    b = pY
    c = pZ
# ---------- end python ----------
pt = ConstructPoint(XCoordinate=python.a, YCoordinate=python.b, ZCoordinate=python.c)
