# Grasshopper definition splitting.gh (Grasshopper 1.0.7)

surface = Surface(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)
python = GhPythonScript(surface=surface, uDiv=Slider(2, range=2..10), vDiv=Slider(10, range=2..10))  # -> out, points; inputs surface: Surface, uDiv: Int32, vDiv: Int32
# ---------- python: Python ----------
import Rhino.Geometry as rg

points = []

## Define the domain
domain = rg.Interval(0,1)
surface.SetDomain(0, domain)
surface.SetDomain(1, domain)

for u in range(uDiv):
    for v in range(vDiv):
        p1 = surface.PointAt(u/uDiv, v/vDiv)
        p2 = surface.PointAt((u+1)/uDiv, v/vDiv)
        p3 = surface.PointAt((u+1)/uDiv, (v+1)/vDiv)
        p4 = surface.PointAt(u/uDiv, (v+1)/vDiv)
        
        ## Create a surface using the 4 points
        panel = rg.NurbsSurface.CreateFromCorners(p1,p2,p3,p4)
        
        points.append(panel)
# ---------- end python ----------
